# Grasshopper definition ToRevit - Residential Unit.gh (Grasshopper 1.0.7)
# plug-ins: Speckle 2, Rhino.Inside for Autodesk Revit

panel = Panel("https://macad.speckle.xyz/streams/fb56d94596/branches/aggregation-units-attribute%2Flarger%20units%20attributes")
receive = Receive(
    Stream=panel,
    AutoReceive=False,
    CurrentComponentState="expired",
    ExpandOutput=True,
    LastInfoMessage="James Foo @ 03/04/2024 23:36:21: UPDATED RESIDENTIAL/RECREATION UNIT (id:0913b14738)",
    ReceiveOnOpen=False,
    ReceivedCommitId="0913b14738",
    StreamWrapper="https://macad.speckle.xyz/streams/fb56d94596/branches/aggregation-units-attribute/larger units attributes",
    selectedKitName="Objects")  # -> Info, Data
dso = DeconstructSpeckleObject(SpeckleObject=receive.Data, selectedKitName="Objects")  # -> BEAMS, PANELS, VERTICALCONNECTION, WALLS

dso_2 = DeconstructSpeckleObject(SpeckleObject=dso.BEAMS, selectedKitName="Objects")
type = Type(
    <familysymbol referenced from the Revit model>,
    SelectedBuiltInCategory="autodesk.revit.category.family:structuralFraming")
s_beam = AddStructuralBeam(Curve=<missing>, Type=type, TrackingMode=2)
parameters = QueryElementParameters(Element=type)
param = ElementParameter(Element=type, Parameter=<missing>, Value=Slider(30, range=0..100))  # -> Element, Value

dso_3 = DeconstructSpeckleObject(SpeckleObject=dso.PANELS, selectedKitName="Objects")
material = AddMaterial(Name="ETFE", TrackingMode=2)
g_shape = AddGeometryDirectShape(
    Name="INFLATED PANELS",
    Category=<geometry referenced from the Revit model>,
    Geometry=<missing>,
    Material=material,
    TrackingMode=2)

number_slider = Slider(-900, range=-1500..1500)
mjoin = MeshJoin(Meshes=flatten(dso_3))
pt = ConstructPoint(XCoordinate=0, YCoordinate=0, ZCoordinate=number_slider)
level = AddLevel(Elevation=number_slider, Name="1.5 TOP OF FLOOR", TrackingMode=2)
sec = MeshPlane(Mesh=mjoin, Plane=pt)
floor = AddFloor(Boundary=sec, Type=<hostobjecttype referenced from the Revit model>, Structural=True, TrackingMode=2)

cir = Circle(Plane=PlaneXY(0, 0, 0), Radius=Slider(1000, range=0..10000))
level_2 = Level(<level referenced from the Revit model>)
level_3 = Level(<level referenced from the Revit model>)
shaft = AddShaftOpening(Boundary=cir, Base=level_2, Top=level_3, TrackingMode=2)

dso_4 = DeconstructSpeckleObject(SpeckleObject=dso.VERTICALCONNECTION, selectedKitName="Objects")
geo = Geometry(dso_4)
end = EndPoints(Curve=geo)  # -> Start, End
avr = Average(Input=end.End)
project = Project(Geometry=dso_4, Plane=avr)  # -> Geometry, Transform
Z = UnitZ(Factor=Slider(150, range=0..1000))
join = JoinCurves(Curves=project.Geometry, Preserve=False)
move = Move(Geometry=join, Motion=Z)  # -> Geometry, Transform
floor_2 = AddFloor(Boundary=move.Geometry, Type=<hostobjecttype referenced from the Revit model>, Structural=True, TrackingMode=2)

dso_5 = DeconstructSpeckleObject(SpeckleObject=dso.WALLS, selectedKitName="Objects")
wallprfl = AddWallProfile(Profile=<missing>, TrackingMode=2)

bang = ExplodeTree(Data=dso_4)  # -> Branch0, Branch1
explode = Explode(Curve=bang.Branch0, Recursive=True)  # -> Segments, Vertices
explode_2 = Explode(Curve=bang.Branch1, Recursive=True)  # -> Segments, Vertices
midpt = CurveMiddle(Curve=explode.Segments)
midpt_2 = CurveMiddle(Curve=explode_2.Segments)
avr_2 = Average(Input=midpt)
avr_3 = Average(Input=midpt_2)
ln = Line(StartPoint=avr_2, EndPoint=avr_3)
type_2 = Type(
    <familysymbol referenced from the Revit model>,
    SelectedBuiltInCategory="autodesk.revit.category.family:structuralFraming")
s_beam_2 = AddStructuralBeam(Curve=ln, Type=type_2, TrackingMode=2)

medges = MeshEdges(Mesh=mjoin)  # -> NakedEdges, InteriorEdges, NonManifoldEdges
demesh = DeconstructMesh(Mesh=mjoin)  # -> Vertices, Faces, Colours, Normals
merge = Merge(Data1=medges.NakedEdges, Data2=medges.InteriorEdges)
pdecon = Deconstruct(Point=demesh.Vertices)  # -> XComponent, YComponent, ZComponent
midpt_3 = CurveMiddle(Curve=merge)
larger = LargerThan(FirstNumber=pdecon.ZComponent, SecondNumber="-.01")  # -> LargerThan, OrEqualTo
pdecon_2 = Deconstruct(Point=midpt_3)  # -> XComponent, YComponent, ZComponent
cull = CullPattern(List=demesh.Vertices, CullPattern=larger.OrEqualTo)
larger_2 = LargerThan(FirstNumber=pdecon_2.ZComponent, SecondNumber="-.01")  # -> LargerThan, OrEqualTo
cull_2 = CullPattern(List=merge, CullPattern=larger_2.OrEqualTo)

project_2 = Project(Geometry=demesh.Vertices, Plane=PlaneXY(0, 0, 0))  # -> Geometry, Transform
hull = ConvexHull(Points=project_2.Geometry, Plane=PlaneXY(0, 0, 0))  # -> Hull, HullZ, Indices

roof = AddRoof(Boundary=hull.Hull, Type=<hostobjecttype referenced from the Revit model>, TrackingMode=2)
h_shape = HostShape(Host=roof, Points=cull, Creases=cull_2)  # -> Host, Exteriors, Interiors
